# Grasshopper definition example_read_write.gh (Grasshopper 1.0.7)
# plug-ins: MQTTwriteV7

mr = MQTTread(Broker="test.mosquitto.org", Topic="testGH", QoS=2)  # -> Data, Counter
mw = MQTTwrite(Broker="test.mosquitto.org", Topic="testGH", Data=Slider(7, range=0..10), QoS=0)  # -> Published, Counter
panel = Panel(mr.Data)
